# Grasshopper definition converterscript2.gh (Grasshopper 0.9.76)
# plug-ins: Python Interpreter

panel = Panel("G:\hackathon_boston_all_buildings.geojson")
panel_2 = Panel("C:\Users\mackey\Documents\GitHub\BEnMap\resources\500_building_sample.geojson")
panel_3 = Panel("C:\Users\mackey\Documents\GitHub\BEnMap\resources\5_building_sample.geojson")
panel_4 = Panel("C:\Users\mackey\Documents\GitHub\BEnMap\resources\Energy_Reporting_Data_Sept2016.csv")
panel_5 = Panel("C:\Users\mackey\Documents\GitHub\BEnMap\resources\10_building_sample.geojson")
python = PythonScript(energyJsonFile=panel_4, geoJsonFile=panel_5)  # -> out, a
# ---------- python: Python ----------
import os

berdoAddresses = []
berdoCSV = open(energyJsonFile, 'r')
for lcount, line in enumerate(berdoCSV):
    if lcount > 6:
        try:
            berdAddress = line.split(",")[19].upper()
            if berdAddress != "NOT AVAILABLE":
                berdoAddresses.append(berdAddress)
        except:
            pass
berdoCSV.close()

geojson = open(geoJsonFile, 'r')
newDict = {}

fullTextStr = ""
for lcount, line in enumerate(geojson):
    if lcount > 5:
        newLine = line.split('null')
        total = ""
        for count, part in enumerate(newLine):
            if count == 0:
                total = part
            else:
                total = total + '"Null"' + part
        
        try:
            obj = eval(total)
            address = obj[0]['properties']['PART_ADDRE'].split(',')[0]
            
            if address in berdoAddresses:
                print address
        except: pass

geojson.close()
# ---------- end python ----------
panel_6 = Panel(python.out)
microclimatemap = Honeybee_MicroclimateMapAnalysis()  # -> readMe, port, radTempMtx, airTempMtx, operativeTempMtx, adaptComfMtx, degFromTargetMtx, port_2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; plug-in component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
